# Grasshopper definition RhinoExporter.gh (Grasshopper 1.0.7)

c_script = CSharpScript(
    Export=Button(),
    Filename="D:\Unity\ALIS_Aggregation\RhinoExporter\export.xml",
    BlockNames="block",
    InstanceLayer="Instances")  # -> out; inputs Export: Boolean, Filename: String, BlockNames: list of String, InstanceLayer: String
# ---------- c_script: C# usings ----------
  using System.Linq;
  using System.Xml;
  using System.Xml.Serialization;
  using Rhino.DocObjects;
# ---------- c_script: C# ----------
    Assembly.Export(BlockNames, InstanceLayer, Filename, Rhino.RhinoDoc.ActiveDoc);

    //assembly.Export(BlockNames,IntanceLayer,1,1,1,Filename,
# ---------- c_script: C# additional code ----------
  //Reduced version of the Extensions Unity Exporter script by Vicente
  public class Assembly
  {
    public List<Instance> Instances { get; set; }

    private Assembly() { }

    public static void Export(List<string> blockNames, string instanceLayerName, string fileName, RhinoDoc doc)
    {
      var definitions = blockNames.Select(n => doc.InstanceDefinitions.First(i => i.Name == n));
      var instanceLayer = doc.Layers.FindName(instanceLayerName);

      var assembly = new Assembly()
        {

          Instances = definitions
          .SelectMany(d => d.GetReferences(1).Where(i => i.Attributes.LayerIndex == instanceLayer.Index))
          .Select(d => new Instance(d.InstanceDefinition.Index, d.InstanceXform))
          .ToList(),

          };

      var serializer = new XmlSerializer(typeof(Assembly));
      using (var writer = XmlWriter.Create(fileName))
      {
        serializer.Serialize(writer, assembly);
      }
    }
  }


  public class Instance
  {
    public int DefinitionIndex;
    public Pose Pose;

    private Instance() { }

    public Instance(int definitionIndex, Transform transform)
    {
      DefinitionIndex = definitionIndex;

      var plane = Plane.WorldXY;
      plane.Transform(transform);
      Pose = new Pose(plane);
    }
  }

  [XmlType(TypeName = "Vector3")]
  public struct Vector3Export
  {
    public float x, y, z;

    public Vector3Export(Point3d point)
    {
      x = (float) point.X;
      y = (float) point.Z;
      z = (float) point.Y;
    }

    public Vector3Export(Point3f point)
    {
      x = point.X;
      y = point.Z;
      z = point.Y;
    }
  }

  [XmlType(TypeName = "Vector2")]
  public struct Vector2Export
  {
    public float x, y;

    public Vector2Export(Point2f point)
    {
      x = point.X;
      y = point.Y;
    }
  }

  public struct Pose
  {
    public Vector3Export position;
    public QuaternionExport rotation;

    public Pose(Plane plane)
    {
      position = new Vector3Export(plane.Origin);
      rotation = new QuaternionExport(plane);
    }
  }

  [XmlType(TypeName = "Quaternion")]
  public struct QuaternionExport
  {
    public float x, y, z, w;

    public QuaternionExport(Plane plane)
    {
      var q = Quaternion.Rotation(Plane.WorldXY, plane);
            
      w = (float) -q.A;
      x = (float) q.B;
      y = (float) q.D;
      z = (float) q.C;
    }
  }
# ---------- end c_script ----------
panel = Panel(c_script)
